% Simulink data dictionary main.sldd

Password = Simulink.Signal(StorageClass="ExportToFile", HeaderFile="Constants.h", DefinitionFile="Constants.c", DataType="uint8", Dimensions=32)
Ssid = Simulink.Signal(StorageClass="ExportToFile", HeaderFile="Constants.h", DefinitionFile="Constants.c", DataType="uint8", Dimensions=32)
Model_Step_Setpoint = Simulink.Signal(StorageClass="ExportToFile", HeaderFile="Constants.h", DefinitionFile="Constants.c", DataType="double")

Adt_WiFi_Status = enum(DefaultValue="Disconnected", StorageType="uint8")
  Disconnected = 0
  Connected = 1
  Connecting = 2
  Fail = 3

LED01_PIN = Simulink.Signal(StorageClass="ExportToFile", HeaderFile="Constants.h", DefinitionFile="Constants.c", DataType="uint8", InitialValue="18")
LED01_CH = Simulink.Signal(StorageClass="ExportToFile", HeaderFile="Constants.h", DefinitionFile="Constants.c", DataType="uint8", InitialValue="0")
LED01_RES = Simulink.Signal(StorageClass="ExportToFile", HeaderFile="Constants.h", DefinitionFile="Constants.c", DataType="uint8", InitialValue="8")
LED01_FREQ = Simulink.Signal(StorageClass="ExportToFile", HeaderFile="Constants.h", DefinitionFile="Constants.c", DataType="uint16", InitialValue="1000")
LED02_PIN = Simulink.Signal(StorageClass="ExportToFile", HeaderFile="Constants.h", DefinitionFile="Constants.c", DataType="uint8", InitialValue="19")
LED03_PIN = Simulink.Signal(StorageClass="ExportToFile", HeaderFile="Constants.h", DefinitionFile="Constants.c", DataType="uint8", InitialValue="21")
LED02_CH = Simulink.Signal(StorageClass="ExportToFile", HeaderFile="Constants.h", DefinitionFile="Constants.c", DataType="uint8", InitialValue="1")
LED02_RES = Simulink.Signal(StorageClass="ExportToFile", HeaderFile="Constants.h", DefinitionFile="Constants.c", DataType="uint8", InitialValue="8")
LED02_FREQ = Simulink.Signal(StorageClass="ExportToFile", HeaderFile="Constants.h", DefinitionFile="Constants.c", DataType="uint16", InitialValue="1000")
LED03_CH = Simulink.Signal(StorageClass="ExportToFile", HeaderFile="Constants.h", DefinitionFile="Constants.c", DataType="uint8", InitialValue="2")
LED03_RES = Simulink.Signal(StorageClass="ExportToFile", HeaderFile="Constants.h", DefinitionFile="Constants.c", DataType="uint8", InitialValue="8")
LED03_FREQ = Simulink.Signal(StorageClass="ExportToFile", HeaderFile="Constants.h", DefinitionFile="Constants.c", DataType="uint16", InitialValue="1000")
WiFi_LED_PIN = Simulink.Signal(StorageClass="ExportToFile", HeaderFile="Constants.h", DefinitionFile="Constants.c", DataType="uint8", InitialValue="2")

Adt_RunMode = enum(DefaultValue="Alexa", StorageType="uint8")
  AllOn = 1
  Alexa = 0

LED01_ID = Simulink.Signal(StorageClass="ExportToFile", HeaderFile="Constants.h", DefinitionFile="Constants.c", DataType="uint8", InitialValue="[108 117 122 32 118 101 114 109 101 108 104 97]")
LED02_ID = Simulink.Signal(StorageClass="ExportToFile", HeaderFile="Constants.h", DefinitionFile="Constants.c", DataType="uint8", InitialValue="[108 117 122 32 97 109 97 114 101 108 97]")
LED03_ID = Simulink.Signal(StorageClass="ExportToFile", HeaderFile="Constants.h", DefinitionFile="Constants.c", DataType="uint8", InitialValue="[108 117 122 32 97 122 117 108]")